# Dynamo graph APIJourney_Part_1.dyn "APIJourny_Part_1" (Dynamo 2.4.0.6186)
# packages: JsonData 2.0.2

string = StringInput("""{
  "Types": {
    "LengthUnits": {
      "Kind": "ENUM",
      "NativeType": "Autodesk.Revit.DB.DisplayUnitType",
      "Mappings": {
        "ft": "DUT_DECIMAL_FEET",
        "in": "DUT_DECIMAL_INCHES",
        "m": "DUT_METERS",
        "mm": "DUT_MILLIMETERS",
        "cm": "DUT_CENTIMETERS"
      }

    },
    "AreaUnits": {
      "Kind": "ENUM",
      "NativeType": "Autodesk.Revit.DB.DisplayUnitType",
      "Mappings": {
        "mm2": "DUT_SQUARE_METERS",
        "ft2": "DUT_SQUARE_FEET"
      }

    },
    "VolumeUnits": {
      "Kind": "ENUM",
      "NativeType": "Autodesk.Revit.DB.DisplayUnitType",
      "Mappings": {
        "mm3": "DUT_CUBIC_METERS",
        "ft3": "DUT_CUBIC_FEET"
      }

    },
    "CurrentUnits": {
      "Kind": "ENUM",
      "NativeType": "Autodesk.Revit.DB.DisplayUnitType",
      "Mappings": {
        "A": "DUT_AMPERES",
        "mA": "DUT_MILLIAMPERES",
        "kA": "DUT_KILOAMPERES"
      }

    },
    "VoltageUnits": {
      "Kind": "ENUM",
      "NativeType": "Autodesk.Revit.DB.DisplayUnitType, RevitAPI",
      "Mappings": {
        "V": "DUT_VOLTS",
        "mV": "DUT_MILLIVOLTS",
        "kV": "DUT_KILOVOLTS"
      }

    },
    "PowerUnits": {
      "Kind": "ENUM",
      "NativeType": "Autodesk.Revit.DB.DisplayUnitType",
      "Mappings": {
        "W": "DUT_WATTS",
        "kW": "DUT_KILOWATTS"
      }

    },
    "Space": {
      "Kind": "OBJECT",
      "NativeType": "Autodesk.Revit.DB.Space",
      "Create": "CreateSpace",
      "Delete": "DeleteSpace",
      "Update": "UpdateSpace",
      "Mappings": {}
    }
  }
}""")

# group: Client setup
string_2 = StringInput("http://localhost:4001/graphql")
clientMapping = ClientMapping.ClientMapping(mappingJSON=string)
buildingGraphAPIClient = BuildingGraphAPIClient.BuildingGraphAPIClient(endpointURL=string_2, clientMapping=clientMapping)

watch = Watch(buildingGraphAPIClient)
code_block = CodeBlock { "GF"; "L01"; "L02"; "L03"; "L04"; "L05"; "L06"; "L07"; "L08"; "L09"; "RF"; }
code_block_2 = CodeBlock { "Abbreviation"; }
code_block_3 = CodeBlock { "Id"; }
code_block_4 = CodeBlock()
# ---------- code_block_4.designscript (11 lines) ----------
"Ground floor";
"Level 01a";
"Level 02";
"Level 03";
"Level 04";
"Level 05";
"Level 06";
"Level 07";
"Level 08";
"Level 09";
"Roof";
# ----------------------------------------
code_block_5 = CodeBlock { 0; 5; 10; 15; 20; 25; 30; 35; 40; 45; 50; }

# group: Input values
string_3 = StringInput("Project Graph")
string_4 = StringInput("Dynamo Tower")
list_create = List.Create(item0=code_block.out0, item1=code_block.out1, item2=code_block.out2, item3=code_block.out3, item4=code_block.out4, item5=code_block.out5, item6=code_block.out6, item7=code_block.out7, item8=code_block.out8, item9=code_block.out9, item10=code_block.out10)
list_create_2 = List.Create(item0=string_3, item1=string_4, item2=list_create)
list_create_3 = List.Create(item0=code_block_4.out0, item1=code_block_4.out1, item2=code_block_4.out2, item3=code_block_4.out3, item4=code_block_4.out4, item5=code_block_4.out5, item6=code_block_4.out6, item7=code_block_4.out7, item8=code_block_4.out8, item9=code_block_4.out9, item10=code_block_4.out10)
list_create_4 = List.Create(item0=code_block_5.out0, item1=code_block_5.out1, item2=code_block_5.out2, item3=code_block_5.out3, item4=code_block_5.out4, item5=code_block_5.out5, item6=code_block_5.out6, item7=code_block_5.out7, item8=code_block_5.out8, item9=code_block_5.out9, item10=code_block_5.out10)

# group: Query model for existing elements
code_block_6 = CodeBlock()
# ---------- code_block_6.designscript (15 lines) ----------
"query ($projectName: String, $buildingName: String, $levelNumbers: [String!]) {
  Project(Name: $projectName) {
    Name
    Id
  }
  Building(Name: $buildingName) {
    Name
    Id
    Levels(filter: {Abbreviation_in: $levelNumbers}) {
      Name
      Abbreviation
      Id
    }
  }
}";
# ----------------------------------------
code_block_7 = CodeBlock { ["projectName","buildingName","levelNumbers"]; }
byKeysValues = DesignScript.Builtin.Dictionary.ByKeysValues(keys=code_block_7, values=list_create_2)
BGGraphQLQuery = Queries.BGGraphQLQuery(client=buildingGraphAPIClient, query=code_block_6, inputVariables=byKeysValues)
watch_2 = Watch(BGGraphQLQuery)

string_5 = JsonData.Utilities.Parse.String(jsonString=BGGraphQLQuery)

# group: Find existing Building
code_block_8 = CodeBlock { "Building"; }
getValueByKey = JsonObject.GetValueByKey(jsonObject=string_5, keys=code_block_8, Nesting=false, Option="None")
firstItem = List.FirstItem(list=getValueByKey)
code_block_9 = CodeBlock { "Id"; }
getValueByKey_2 = JsonObject.GetValueByKey(jsonObject=firstItem, keys=code_block_9, Nesting=false, Option="None")
watch_3 = Watch(getValueByKey_2)

# group: Find existing Levels
code_block_10 = CodeBlock { "Levels"; }
getValueByKey_3 = JsonObject.GetValueByKey(jsonObject=firstItem, keys=code_block_10, Nesting=false, Option="None")
code_block_11 = CodeBlock { "Abbreviation"; }
filterByKeyAndValue = JsonData.Elements.JsonObject.FilterByKeyAndValue(jsonObjects=getValueByKey_3, key=code_block_11, value=list_create)
code_block_12 = CodeBlock { "Id"; }
getValueByKey_4 = JsonObject.GetValueByKey(jsonObject=filterByKeyAndValue.in@L2, keys=code_block_12, Nesting=false, Option="None")

getValueByKey_5 = JsonObject.GetValueByKey(jsonObject=getValueByKey_3, keys=code_block_2, Nesting=true, Option="None")
getValueByKey_6 = JsonObject.GetValueByKey(jsonObject=getValueByKey_3, keys=code_block_3, Nesting=true, Option="None")
byKeysValues_2 = DesignScript.Builtin.Dictionary.ByKeysValues(keys=getValueByKey_5, values=getValueByKey_6)
valueAtKey = DesignScript.Builtin.Dictionary.ValueAtKey(dictionary=byKeysValues_2, key=list_create)
watch_4 = Watch(valueAtKey)
list_create_5 = List.Create(item0=list_create_3, item1=list_create, item2=list_create_4)
transpose = List.Transpose(lists=list_create_5)
watch_5 = Watch(transpose)

# group: Create Levels
code_block_13 = CodeBlock { "Level"; }
fromNameAndId = BGNode.FromNameAndId(name=code_block_13, id=watch_4, lacing=Longest)
code_block_14 = CodeBlock { ["Name", "Abbreviation", "Elevation"]; }
byKeysValues_3 = DesignScript.Builtin.Dictionary.ByKeysValues(keys=code_block_14, values=watch_5@L2)
createNode = Mutations.CreateNode(client=watch, node=fromNameAndId, vars=byKeysValues_3, lacing=Longest)
updateNode = Mutations.UpdateNode(client=watch, node=createNode, vars=byKeysValues_3, lacing=Longest)

id = BGNode.Id(bGNode=updateNode)
watch_6 = Watch(id)
watch_7 = Watch(watch)

# group: Query all spaces
code_block_15 = CodeBlock()
# ---------- code_block_15.designscript (12 lines) ----------
"query {
  Space {
    Id
    Name
    Number
    Area(unit:m2)
    Volume
    BaseLevel {
    	Name
    }
   }
}";
# ----------------------------------------
byKeysValues_4 = DesignScript.Builtin.Dictionary.ByKeysValues()  # unwired: keys, values
BGGraphQLQuery_2 = Queries.BGGraphQLQuery(client=watch_7, query=code_block_15, inputVariables=byKeysValues_4)

watch_8 = Watch(BGGraphQLQuery_2)

# group: Find existing Project
code_block_16 = CodeBlock { "Project"; }
getValueByKey_7 = JsonObject.GetValueByKey(jsonObject=string_5, keys=code_block_16, Nesting=false, Option="None")
firstItem_2 = List.FirstItem(list=getValueByKey_7)
code_block_17 = CodeBlock { "Id"; }
getValueByKey_8 = JsonObject.GetValueByKey(jsonObject=firstItem_2, keys=code_block_17, Nesting=false, Option="None")
watch_9 = Watch(getValueByKey_8)

# group: Create Project
code_block_18 = CodeBlock { "Project"; }
fromNameAndId_2 = BGNode.FromNameAndId(name=code_block_18, id=watch_9)
code_block_19 = CodeBlock { ["Name"]; }
code_block_20 = CodeBlock(pn=string_3) { pn; [pn]; }
byKeysValues_5 = DesignScript.Builtin.Dictionary.ByKeysValues(keys=code_block_19, values=code_block_20.out1)
createNode_2 = Mutations.CreateNode(client=watch, node=fromNameAndId_2, vars=byKeysValues_5, lacing=Longest)
updateNode_2 = Mutations.UpdateNode(client=watch, node=createNode_2, vars=byKeysValues_5, lacing=Longest)

# group: Create Building
code_block_21 = CodeBlock { "Building"; }
fromNameAndId_3 = BGNode.FromNameAndId(name=code_block_21, id=watch_3)
code_block_22 = CodeBlock { ["Name"]; }
code_block_23 = CodeBlock(bn=string_4) { bn; [bn]; }
byKeysValues_6 = DesignScript.Builtin.Dictionary.ByKeysValues(keys=code_block_22, values=code_block_23.out1)
createNode_3 = Mutations.CreateNode(client=watch, node=fromNameAndId_3, vars=byKeysValues_6, lacing=Longest)
updateNode_3 = Mutations.UpdateNode(client=watch, node=createNode_3, vars=byKeysValues_6, lacing=Longest)

# group: Add building to project
code_block_24 = CodeBlock { "INCLUDES"; }
relateNode = Mutations.RelateNode(client=watch, fromNode=updateNode_2, toNode=updateNode_3, relationshipType=code_block_24)
watch_10 = Watch(relateNode)

# group: Add levels to building
code_block_25 = CodeBlock { "IS_IN"; }
relateNode_2 = Mutations.RelateNode(client=watch, fromNode=updateNode@L1, toNode=updateNode_3, relationshipType=code_block_25)
watch_11 = Watch(relateNode_2)

watch_12 = Watch(fromNameAndId)
firstItem_3 = List.FirstItem(list=getValueByKey_4@L2)

# group (continued): Find existing Levels
watch_13 = Watch(firstItem_3)

now = DateTime.Now()
string_6 = StringInput("hhmmss")
format = DateTime.Format(dateTime=now, format=string_6)
