# Grasshopper definition APIJourney_Part_2.gh (Grasshopper 0.9.76)
# plug-ins: BuildingGraph.Client.RhinoGrasshopper, ghJSON

panel = Panel("Basic building outline")

external_walls = Curve(<curve referenced from the Rhino model>)
floor_plan = Curve([<curve referenced from the Rhino model> x4])
cores = Curve(<curve referenced from the Rhino model>)

panel_2 = Panel("""query ($projectName: String, $buildingName: String) {
  Project(Name: $projectName) {
    Name
    Id
    Buildings(filter: {Name: $buildingName}) {
      Name
      Id
      Levels {
        Name
        Abbreviation
        Elevation
        Id
      }
    }
  }
}""")
panel_3 = Panel("http://localhost:4001/graphql")
merge = Merge(Data1="Project Graph", Data2="Dynamo Tower")
merge_2 = Merge(Data1="projectName", Data2="buildingName")
run_query = BGQuery(Endpoint=panel_3, Query=panel_2, Vn=merge_2, Vv=merge)
frmjson = FromJSON(JSON=run_query)
panel_4 = Panel(run_query)
jpath = JSONPath(JObject=frmjson, JSONPathQuery="$.Project[0].Buildings[0].Levels[*]")
jpath_2 = JSONPath(JObject=frmjson, JSONPathQuery="$.Project[0].Buildings[0].Levels[*].Elevation")

panel_5 = Panel("Get all Levels")
# Sort levels in order of elevation
sort = SortList(Keys=jpath_2, ValuesA=jpath)  # -> Keys, ValuesA
panel_6 = Panel("Form Spaces")
explode = Explode(Curve=external_walls, Recursive=True)  # -> Segments, Vertices

int = Integer(-1)
bool = Boolean(False)
shift = ShiftList(List=sort.ValuesA, Shift=int, Wrap=bool)
frmjson_2 = FromJSON(JSON=shift)
jpath_3 = JSONPath(JObject=frmjson_2, JSONPathQuery="$.Id")
jpath_4 = JSONPath(JObject=frmjson_2, JSONPathQuery="$.Abbreviation")
panel_7 = Panel(jpath_4)
panel_8 = Panel(jpath_3)

bool_2 = Boolean(True)
int_2 = Integer(-1)
bool_3 = Boolean(False)
int_3 = Integer(-1)
shift_2 = ShiftList(List=sort.Keys, Shift=int_2, Wrap=bool_2)
shift_3 = ShiftList(List=sort.Keys, Shift=int_3, Wrap=bool_3)
subtraction = Subtraction(A=sort.Keys, B=shift_2)
bool_4 = Boolean(False)
bool_5 = Boolean(True)
int_4 = Integer(1)
offset = Offset(Surface=graft(floor_plan), Distance=shift_3, Retrim=bool_4)
shift_4 = ShiftList(List=subtraction, Shift=int_4, Wrap=bool_5)
bool_6 = Boolean(False)
int_5 = Integer(-1)
shift_5 = ShiftList(List=shift_4, Shift=int_5, Wrap=bool_6)

c_script = CSharpScript()  # -> DocPath
# ---------- c_script: C# ----------
    DocPath = RhinoDocument.Path;
# ---------- end c_script ----------
panel_9 = Panel(c_script)
panel_10 = Panel("""query ($ident:String) {
  Model (Identity:$ident)
  {
    Id
  }
}""")
panel_11 = Panel(panel_3)
bgquery = BGQuery(Endpoint=panel_11, Query=panel_10, Vn="ident", Vv=c_script)
frmjson_3 = FromJSON(JSON=bgquery)
jpath_5 = JSONPath(JObject=frmjson_3, JSONPathQuery="$.Model[0].Id")
merge_3 = Merge(Data1=c_script, Data2="Rhino")
merge_4 = Merge(Data1="Identity", Data2="NativeAplication")
bgpush = BGPush(Endpoint=panel_11, ElementName="Model", Id=jpath_5, Vn=merge_4, Vv=merge_3)
panel_12 = Panel(bgpush)

panel_13 = Panel("Find exising models")
panel_14 = Panel("Calculate level heights")

bnd = Bounds(Numbers=sort.Keys)
dedomain = DeconstructDomain(Domain=bnd)  # -> Start, End
Z = UnitZ(Factor=dedomain.End)
srf = Surface(cores)
extr_core = Extrude(Base=srf, Direction=Z)

srf_2 = Surface(offset)
# Create surfaces and extrude to form spaces
Z_2 = UnitZ(Factor=shift_5)
extr_rooms = Extrude(Base=srf_2, Direction=Z_2)

list = ValueList({"1": 0, "2": 1, "3": 2, "4": 3, "5": 4, "6": 5, "7": 6, "8": 7}, selected="2")
window_height = Slider(1.755, range=0..10)
item = ListItem(List=explode.Segments, Index=list, Wrap=True)
nowindows = Slider(2, range=0..100)
cill_height = Slider(1.156, range=0..10)
gvalue = Slider(0.119, range=0.05..0.95)
uvalue = Slider(0.265, range=0.05..0.95)
wwr = Slider(0.554, range=0.05..0.95)
crv = Curve(item)
merge_5 = Merge(Data1=wwr, Data2=nowindows, Data3=uvalue, Data4=gvalue, Data5=window_height, Data6=cill_height, Data7=crv)

list_2 = ValueList({"1": 0, "2": 1, "3": 2, "4": 3, "5": 4, "6": 5, "7": 6, "8": 7}, selected="6")
window_height_2 = Slider(2.979, range=0..10)
item_2 = ListItem(List=explode.Segments, Index=list_2, Wrap=True)
nowindows_2 = Slider(3, range=0..100)
cill_height_2 = Slider(1.114, range=0..10)
gvalue_2 = Slider(0.119, range=0.05..0.95)
uvalue_2 = Slider(0.265, range=0.05..0.95)
wwr_2 = Slider(0.7, range=0.05..0.95)
crv_2 = Curve(item_2)
merge_6 = Merge(Data1=wwr_2, Data2=nowindows_2, Data3=uvalue_2, Data4=gvalue_2, Data5=window_height_2, Data6=cill_height_2, Data7=crv_2)

list_3 = ValueList({"1": 0, "2": 1, "3": 2, "4": 3, "5": 4, "6": 5, "7": 6, "8": 7}, selected="1")
window_height_3 = Slider(1.544, range=0..10)
item_3 = ListItem(List=explode.Segments, Index=list_3, Wrap=True)
cill_height_3 = Slider(0.836, range=0..10)
nowindows_3 = Slider(3, range=0..100)
gvalue_3 = Slider(0.119, range=0.05..0.95)
uvalue_3 = Slider(0.265, range=0.05..0.95)
wwr_3 = Slider(0.557, range=0.05..0.95)
crv_3 = Curve(item_3)
merge_7 = Merge(Data1=wwr_3, Data2=nowindows_3, Data3=uvalue_3, Data4=gvalue_3, Data5=window_height_3, Data6=cill_height_3, Data7=crv_3)

list_4 = ValueList({"1": 0, "2": 1, "3": 2, "4": 3, "5": 4, "6": 5, "7": 6, "8": 7}, selected="5")
window_height_4 = Slider(0.829, range=0..10)
item_4 = ListItem(List=explode.Segments, Index=list_4, Wrap=True)
nowindows_4 = Slider(3, range=0..100)
cill_height_4 = Slider(1.338, range=0..10)
gvalue_4 = Slider(0.119, range=0.05..0.95)
uvalue_4 = Slider(0.265, range=0.05..0.95)
wwr_4 = Slider(0.705, range=0.05..0.95)
crv_4 = Curve(item_4)
merge_8 = Merge(Data1=wwr_4, Data2=nowindows_4, Data3=uvalue_4, Data4=gvalue_4, Data5=window_height_4, Data6=cill_height_4, Data7=crv_4)

list_5 = ValueList({"1": 0, "2": 1, "3": 2, "4": 3, "5": 4, "6": 5, "7": 6, "8": 7}, selected="3")
window_height_5 = Slider(1.517, range=0..10)
item_5 = ListItem(List=explode.Segments, Index=list_5, Wrap=True)
nowindows_5 = Slider(2, range=0..100)
cill_height_5 = Slider(0.999, range=0..10)
gvalue_5 = Slider(0.119, range=0.05..0.95)
uvalue_5 = Slider(0.265, range=0.05..0.95)
wwr_5 = Slider(0.684, range=0.05..0.95)
crv_5 = Curve(item_5)
merge_9 = Merge(Data1=wwr_5, Data2=nowindows_5, Data3=uvalue_5, Data4=gvalue_5, Data5=window_height_5, Data6=cill_height_5, Data7=crv_5)

list_6 = ValueList({"1": 0, "2": 1, "3": 2, "4": 3, "5": 4, "6": 5, "7": 6, "8": 7}, selected="7")
window_height_6 = Slider(1.597, range=0..10)
item_6 = ListItem(List=explode.Segments, Index=list_6, Wrap=True)
nowindows_6 = Slider(2, range=0..100)
cill_height_6 = Slider(1.364, range=0..10)
gvalue_6 = Slider(0.119, range=0.05..0.95)
uvalue_6 = Slider(0.265, range=0.05..0.95)
wwr_6 = Slider(0.433, range=0.05..0.95)
crv_6 = Curve(item_6)
merge_10 = Merge(Data1=wwr_6, Data2=nowindows_6, Data3=uvalue_6, Data4=gvalue_6, Data5=window_height_6, Data6=cill_height_6, Data7=crv_6)

list_7 = ValueList({"1": 0, "2": 1, "3": 2, "4": 3, "5": 4, "6": 5, "7": 6, "8": 7}, selected="4")
window_height_7 = Slider(1.5, range=0..10)
item_7 = ListItem(List=explode.Segments, Index=list_7, Wrap=True)
nowindows_7 = Slider(2, range=0..100)
cill_height_7 = Slider(1.073, range=0..10)
gvalue_7 = Slider(0.119, range=0.05..0.95)
uvalue_7 = Slider(0.265, range=0.05..0.95)
wwr_7 = Slider(0.705, range=0.05..0.95)
crv_7 = Curve(item_7)
merge_11 = Merge(Data1=wwr_7, Data2=nowindows_7, Data3=uvalue_7, Data4=gvalue_7, Data5=window_height_7, Data6=cill_height_7, Data7=crv_7)

list_8 = ValueList({"1": 0, "2": 1, "3": 2, "4": 3, "5": 4, "6": 5, "7": 6, "8": 7}, selected="8")
window_height_8 = Slider(2.722, range=0..10)
item_8 = ListItem(List=explode.Segments, Index=list_8, Wrap=True)
nowindows_8 = Slider(3, range=0..100)
cill_height_8 = Slider(0.583, range=0..10)
gvalue_8 = Slider(0.119, range=0.05..0.95)
uvalue_8 = Slider(0.265, range=0.05..0.95)
wwr_8 = Slider(0.788, range=0.05..0.95)
crv_8 = Curve(item_8)
merge_12 = Merge(Data1=wwr_8, Data2=nowindows_8, Data3=uvalue_8, Data4=gvalue_8, Data5=window_height_8, Data6=cill_height_8, Data7=crv_8)

wall_height = Slider(13.784, range=0..1000)
wall_thickness = Slider(0.5, range=0..1)
num = Number(dedomain.End)
num_2 = Number(wall_thickness)

panel_15 = Panel("Create model")
panel_16 = Panel("Analysis")
area = Area(Geometry=srf_2)  # -> Area, Centroid
volume = Volume(Geometry=extr_rooms)  # -> Volume, Centroid

num_3 = Number(0.012)
# Do some basic space analysis
heating_load = Multiplication(A=area.Area, B=num_3)
density = Division(A=heating_load, B=area.Area)

single_outles = Slider(2, range=0..10)
twin_outlets = Slider(4, range=0..10)
pdecon = Deconstruct(Point=area.Centroid)  # -> XComponent, YComponent, ZComponent

lng = ListLength(List=extr_rooms)
# Build up parameters to write to the spaces
index = ItemIndex(List=flatten(extr_rooms), Item=extr_rooms)
repeat = RepeatData(Data=flatten(jpath_4), Length=lng)
repeat_2 = RepeatData(Data=flatten(jpath_3), Length=lng)
space_name = CSharpScript(x=index, y=repeat)  # -> out, A
# ---------- space_name: C# ----------
    A = string.Format("{0}-0{1}", y, x);
# ---------- end space_name ----------

entwine = Entwine(
    Branch00=merge_7,
    Branch01=merge_5,
    Branch02=merge_9,
    Branch03=merge_11,
    Branch04=merge_8,
    Branch05=merge_6,
    Branch06=merge_10,
    Branch07=merge_12,
    FlattenInputs=True)
weave = Weave(
    Pattern=[0, 1, 2, 3, 4, 5, 6, 7, 8, 9, 10],
    Stream0=graft(repeat),
    Stream1=graft(space_name.A),
    Stream2=graft(area.Area),
    Stream3=graft(volume.Volume),
    Stream4=graft(heating_load),
    Stream5=graft(density),
    Stream6=graft(pdecon.XComponent),
    Stream7=graft(pdecon.YComponent),
    Stream8=graft(pdecon.ZComponent),
    Stream9=graft(single_outles),
    Stream10=graft(twin_outlets),
    NullGaps=False)

bool_7 = Boolean(False)
int_6 = Integer(6)
item_9 = ListItem(List=entwine, Index=int_6, Wrap=bool_7)  # -> flatten(Item)

panel_17 = Panel("Find existing spaces")

panel_18 = Panel("""query ($uid:String){
ModelElement (UniqueId:$uid){
  Id
 }
}""")
panel_19 = Panel(panel_3)
int_7 = Integer(1)
ins = InsertItems(List=graft(space_name.A), Item=bgpush, Indices=int_7, Wrap=True)
merge_13 = Merge(Data1="mid", Data2="uid")
bgquery_2 = BGQuery(Endpoint=panel_19, Query=panel_18, Vn="uid", Vv=ins)
frmjson_4 = FromJSON(JSON=bgquery_2)
jpath_6 = JSONPath(JObject=frmjson_4, JSONPathQuery="$.ModelElement[0].Id")
bgpush_2 = BGPush(Endpoint=panel_19, ElementName="ModelElement", Id=jpath_6, Vn="UniqueId", Vv=ins)
panel_20 = Panel(jpath_6)

pt = ConstructPoint(XCoordinate=0, YCoordinate=0, ZCoordinate=num)
extr = Extrude(Base=item_9, Direction=pt)

index_2 = ItemIndex(List=extr, Item=extr)
int_8 = Integer(1)
int_9 = Integer(6)
addition = Addition(A=index_2, B=int_8)
num_4 = Number(0.5)
tag = TextTag3D(Location=extr, Text=addition, Size=num_4, Justification=int_9)

panel_21 = Panel("Create Model element")
# Add to Spaces to Levels
panel_22 = Panel("Create/Update Spaces")

num_5 = Number(-1)
join = JoinCurves(Curves=item_9, Preserve=False)
multiplication = Multiplication(A=num_2, B=num_5)
pt_2 = ConstructPoint(XCoordinate=0, YCoordinate=0, ZCoordinate=num)
offset_2 = Offset(Curve=join, Distance=multiplication, Plane=PlaneXY(0, 0, 0), Corners=1)
srf_3 = Surface(offset_2)
srf_4 = Surface(join)
extr_2 = Extrude(Base=srf_4, Direction=pt_2)
extr_3 = Extrude(Base=srf_3, Direction=pt_2)
move = Move(Geometry=srf_3, Motion=pt_2)  # -> Geometry, Transform
sdiff = SolidDifference(BrepsA=extr_3, BrepsB=extr_2)

num_6 = Number(1)
Z_3 = UnitZ(Factor=shift_3)
vec = VectorXYZ(XComponent=0, YComponent=0, ZComponent=0)  # -> Vector, Length; disabled
domain = Domain(Domain(0, 2))
range = Range(Domain=domain, Steps=10)

int_10 = Integer(1)
item_10 = ListItem(List=weave, Index=int_10, Wrap=True)
int_11 = Integer(2)

panel_23 = Panel(item_10)

panel_24 = Panel(merge)
panel_25 = Panel("""query ($projectName:String $buidingName:String $levelAbbreviation:String $spaceNumber:String) {
  Space (filter:{Number:$spaceNumber BaseLevel:{Abbreviation:$levelAbbreviation Building:{Name:$buidingName Projects_some:{Name:$projectName}}}} )
  {
    Name
    Id
  }
}""")
panel_26 = Panel(merge_2)
panel_27 = Panel(panel_3)

merge_14 = Merge(Data1=panel_26, Data2="spaceNumber")
ins_2 = InsertItems(List=panel_24, Item=item_10, Indices=int_11, Wrap=True)

bgquery_3 = BGQuery(Endpoint=panel_27, Query=panel_25, Vn=merge_14, Vv=ins_2)
frmjson_5 = FromJSON(JSON=bgquery_3)
jpath_7 = JSONPath(JObject=frmjson_5, JSONPathQuery="$.Space[0].Id")
panel_28 = Panel(jpath_7)

panel_29 = Panel(panel_27)
merge_15 = Merge(
    Data1="Name",
    Data2="Number",
    Data3="Area",
    Data4="Volume",
    Data5="Space_Heating_Load",
    Data6="Space_Heating_Load_Density",
    Data7="CenterX",
    Data8="CenterY",
    Data9="CenterZ",
    Data10="Number_of_230V_Single_Sockets_Non_Essential",
    Data11="Number_of_230V_Twin_Sockets_Non_Essential")
bgpush_3 = BGPush(Endpoint=panel_29, ElementName="Space", Id=jpath_7, Vn=merge_15, Vv=weave)

flatten = FlattenTree(Tree=bgpush_2, Path="{0}")
bgrelate = BGRelate(Endpoint=panel_29, FromNode="ModelElement", FromId=flatten, ToNode="Model", ToId=bgpush, RelationshipName="IS_IN")  # -> FromNodeID, ToNodeID
# Relate spaces to model elements
panel_30 = Panel(bgrelate.FromNodeID)

# ----
# Relate Spaces to levels
flatten_2 = FlattenTree(Tree=bgpush_3, Path="{0}")
flatten_3 = FlattenTree(Tree=repeat_2, Path="{0}")
bgrelate_2 = BGRelate(Endpoint=panel_29, FromNode="Space", FromId=flatten_2, ToNode="Level", ToId=flatten_3, RelationshipName="IS_ON")  # -> FromNodeID, ToNodeID
panel_31 = Panel(bgrelate_2.FromNodeID)

# ----
# Relate model elements to model
flatten_4 = FlattenTree(Tree=bgpush_3, Path="{0}")
flatten_5 = FlattenTree(Tree=bgrelate.FromNodeID, Path="{0}")
panel_32 = Panel("ModelElement")
bgrelate_3 = BGRelate(
    Endpoint=panel_29,
    FromNode="Space",
    FromId=flatten_4,
    ToNode="ModelElement",
    ToId=flatten_5,
    RelationshipName="REALIZED_BY")  # -> FromNodeID, ToNodeID
panel_33 = Panel(bgrelate_3.FromNodeID)

bool_8 = Boolean(False)
int_12 = Integer(1)
item_11 = ListItem(List=entwine, Index=int_12, Wrap=bool_8)  # -> flatten(Item)
num_7 = Number(0)
addition_2 = Addition(A=num_7, B=item_11)
divide = DivideCurve(Curve=item_9, Count=addition_2, Kinks=False)  # -> Points, Tangents, Parameters
pline = PolyLine(Vertices=divide.Points, Closed=False)
bool_9 = Boolean(False)
int_13 = Integer(5)
item_12 = ListItem(List=entwine, Index=int_13, Wrap=bool_9)  # -> flatten(Item)
explode_2 = Explode(Curve=pline, Recursive=True)  # -> Segments, Vertices
curvepoint = PointOnCurve(explode_2.Segments, parameter=0.502)
vec_2 = VectorXYZ(XComponent=0, YComponent=0, ZComponent=item_12)  # -> Vector, Length
move_2 = Move(Geometry=curvepoint, Motion=graft(vec_2.Vector))  # -> Geometry, Transform
pl_origin = PlaneOrigin(Base=graft(extr), Origin=move_2.Geometry)
crv_cp = CurveClosestPoint(Point=pl_origin, Curve=graft(item_9))  # -> Point, Parameter, Distance
num_8 = Number(-0.5)
cdiv = Derivatives(Curve=graft(item_9), Parameter=crv_cp.Parameter)  # -> Point, FirstDerivative

bool_10 = Boolean(False)
int_14 = Integer(0)
len = Length(Curve=item_9)
item_13 = ListItem(List=entwine, Index=int_14, Wrap=bool_10)  # -> flatten(Item)
multiplication_2 = Multiplication(A=item_13, B=len)
division = Division(A=multiplication_2, B=item_11)

bool_11 = Boolean(False)
int_15 = Integer(4)
item_14 = ListItem(List=entwine, Index=int_15, Wrap=bool_11)  # -> flatten(Item)
rectangle = Rectangle(Plane=pl_origin, XSize=graft(item_14), YSize=graft(division), Radius=0)  # -> Rectangle, Length

multiplication_3 = Multiplication(A=graft(division), B=num_8)
multiplication_4 = Multiplication(A=cdiv.FirstDerivative, B=multiplication_3)

move_3 = Move(Geometry=rectangle.Rectangle, Motion=multiplication_4)  # -> Geometry, Transform
srf_5 = Surface(move_3.Geometry)
pt_3 = ConstructPoint(XCoordinate=num_6, YCoordinate=num_6, ZCoordinate=0)
evalsrf = EvaluateSurface(Surface=srf_5, Point=pt_3)  # -> Point, Normal, Frame
num_9 = Number(num_2)
multiplication_5 = Multiplication(A=evalsrf.Normal, B=num_9)
extr_4 = Extrude(Base=flatten(srf_5), Direction=flatten(multiplication_5))  # disabled

fpatch = FragmentPatch(Boundary=extr)  # disabled
pt_4 = ConstructPoint(XCoordinate=0, YCoordinate=0, ZCoordinate=0)
evalsrf_2 = EvaluateSurface(Surface=fpatch, Point=pt_4)  # -> Point, Normal, Frame
multiplication_6 = Multiplication(A=evalsrf_2.Normal, B=num_9)
extr_5 = Extrude(Base=fpatch, Direction=multiplication_6)

move_4 = Move(Geometry=graft(extr_4), Motion=Z_3)  # -> Geometry, Transform
sunion = SolidUnion(Breps=flatten(move_4.Geometry))

sdiff_2 = SolidDifference(BrepsA=flatten(sdiff), BrepsB=flatten(sunion))
srf_6 = Surface(move.Geometry)
srf_7 = Surface(srf_3)
srf_8 = Surface(srf_5)

mesh = Mesh(srf_6)
mesh_2 = Mesh(srf_7)
mesh_3 = Mesh(sdiff_2)
mcol = MeshColours(Mesh=mesh_3, Colours=[ColourSwatch(SwatchColor=RGB(153, 126, 72)), ColourSwatch(SwatchColor=RGB(209, 146, 50))])
mcol_2 = MeshColours(Mesh=mesh_2, Colours=ColourSwatch(SwatchColor=RGB(84, 76, 54)))
mcol_3 = MeshColours(Mesh=mesh, Colours=ColourSwatch(SwatchColor=RGBA(196, 188, 167, 21)))
move_5 = Move(Geometry=graft(srf_8), Motion=Z_3)  # -> Geometry, Transform
move_6 = Move(Geometry=graft(srf_7), Motion=Z_3)  # -> Geometry, Transform
boxprop = BoxProperties(Box=move_5.Geometry)  # -> Center, Diagonal, Area, Volume, Degeneracy; disabled
evalsrf_3 = EvaluateSurface(Surface=move_5.Geometry, Point=vec.Vector)  # -> Point, Normal, Frame
mesh_4 = Mesh(move_5.Geometry)
weave_2 = Weave(
    Pattern=range,
    Stream0=graft(evalsrf_3.Normal),
    Stream1=graft(boxprop.Center),
    Stream2=graft(boxprop.Diagonal),
    NullGaps=False)
mcol_4 = MeshColours(
    Mesh=mesh_4,
    Colours=[ColourSwatch(SwatchColor=RGB(50, 204, 209)), ColourSwatch(SwatchColor=RGB(37, 88, 89)), ColourSwatch(SwatchColor=RGB(72, 144, 153))])
panel_34 = Panel(weave_2)
