# Dynamo graph APIJourney_Part_4.dyn "APIJourny_Part_4_v4" (Dynamo 2.2.1.5175)

string = StringInput("""{
  "Types": {
    "LengthUnits": {
      "Kind": "ENUM",
      "NativeType": "Autodesk.Revit.DB.DisplayUnitType",
      "Mappings": {
        "ft": "DUT_DECIMAL_FEET",
        "in": "DUT_DECIMAL_INCHES",
        "m": "DUT_METERS",
        "mm": "DUT_MILLIMETERS",
        "cm": "DUT_CENTIMETERS"
      }

    },
    "AreaUnits": {
      "Kind": "ENUM",
      "NativeType": "Autodesk.Revit.DB.DisplayUnitType",
      "Mappings": {
        "mm2": "DUT_SQUARE_METERS",
        "ft2": "DUT_SQUARE_FEET"
      }

    },
    "VolumeUnits": {
      "Kind": "ENUM",
      "NativeType": "Autodesk.Revit.DB.DisplayUnitType",
      "Mappings": {
        "mm3": "DUT_CUBIC_METERS",
        "ft3": "DUT_CUBIC_FEET"
      }

    },
    "CurrentUnits": {
      "Kind": "ENUM",
      "NativeType": "Autodesk.Revit.DB.DisplayUnitType",
      "Mappings": {
        "A": "DUT_AMPERES",
        "mA": "DUT_MILLIAMPERES",
        "kA": "DUT_KILOAMPERES"
      }

    },
    "VoltageUnits": {
      "Kind": "ENUM",
      "NativeType": "Autodesk.Revit.DB.DisplayUnitType, RevitAPI",
      "Mappings": {
        "V": "DUT_VOLTS",
        "mV": "DUT_MILLIVOLTS",
        "kV": "DUT_KILOVOLTS"
      }

    },
    "PowerUnits": {
      "Kind": "ENUM",
      "NativeType": "Autodesk.Revit.DB.DisplayUnitType",
      "Mappings": {
        "W": "DUT_WATTS",
        "kW": "DUT_KILOWATTS"
      }

    },
    "Space": {
      "Kind": "OBJECT",
      "NativeType": "Autodesk.Revit.DB.Space",
      "Create": "CreateSpace",
      "Delete": "DeleteSpace",
      "Update": "UpdateSpace",
      "Mappings": {}
    }
  }
}""")

# group: Client Setup
code_block = CodeBlock { "http://localhost:4001/graphql"; }
clientMapping = ClientMapping.ClientMapping(mappingJSON=string)
buildingGraphAPIClient = BuildingGraphAPIClient.BuildingGraphAPIClient(endpointURL=code_block, clientMapping=clientMapping)

watch = Watch(buildingGraphAPIClient)
watch_2 = Watch(watch)

# group: INPUT: Document
code_block_2 = CodeBlock { ["projectName","buildingName","modelIdent"]; }
current = Document.Current()
filePath = Document.FilePath(document=current)
watch_3 = Watch(filePath)
code_block_3 = CodeBlock(ident=watch_3) { ident; ["Project Graph","Dynamo Tower",ident]; }
byKeysValues = DesignScript.Builtin.Dictionary.ByKeysValues(keys=code_block_2, values=code_block_3.out1)

# group: Query
code_block_4 = CodeBlock()
# ---------- code_block_4.designscript (40 lines) ----------
"query ($buildingName: String $modelIdent: String) {
  Space(filter: {BaseLevel: {Building: {Name: $buildingName}}}) {
    Id
    Name
    Number
    CenterX(unit:mm)
    CenterY(unit:mm)
    CenterZ(unit:mm)
    ModelElements {
      Id
      UniqueId
    }
    ElectricalOutlets{
      Id
      Name
      Number_Of_Outlets
      ModelElements {
        Id
        UniqueId
      }
    }
  }
  Model (Identity:$modelIdent)
  {
    Id
    ModelElements {
      Id
      UniqueId
    }
  }
  Level{
    Elevation(unit:mm)
    Id
    Name
     ModelElements {
      Id
      UniqueId
    }
  }
}";
# ----------------------------------------
BGGraphQLQuery = Queries.BGGraphQLQuery(client=buildingGraphAPIClient, query=code_block_4, inputVariables=byKeysValues)
watch_4 = Watch(BGGraphQLQuery)

string_2 = JsonData.Utilities.Parse.String(jsonString=watch_4)

# group: Find or create Model node
watch_5 = Watch(watch)
code_block_5 = CodeBlock { "Model"; }
code_block_6 = CodeBlock { "Model"; }
getValueByKey = JsonObject.GetValueByKey(jsonObject=string_2, keys=code_block_6, Nesting=true, Option="None")
code_block_7 = CodeBlock { "Id"; }
getValueByKey_2 = JsonObject.GetValueByKey(jsonObject=getValueByKey, keys=code_block_7, Nesting=true, Option="None")
firstItem = List.FirstItem(list=getValueByKey_2)
fromNameAndId = BGNode.FromNameAndId(name=code_block_5, id=firstItem)
code_block_8 = CodeBlock { ["Identity"]; }
code_block_9 = CodeBlock(ident=watch_3) { ident; [ident]; }
byKeysValues_2 = DesignScript.Builtin.Dictionary.ByKeysValues(keys=code_block_8, values=code_block_9.out1)
createNode = Mutations.CreateNode(client=watch_5, node=fromNameAndId, vars=byKeysValues_2)

# group: INPUT: Spaces
code_block_10 = CodeBlock { "Spaces"; }
byName = Category.ByName(name=code_block_10)
all_elements_of_category = ElementsOfCategory(Category=byName)

# group: Match up abstract spaces to Revit spaces
code_block_11 = CodeBlock { "Space"; }
code_block_12 = CodeBlock { "Space"; }
getValueByKey_3 = JsonObject.GetValueByKey(jsonObject=string_2, keys=code_block_12, Nesting=true, Option="None")
code_block_13 = CodeBlock { ["Id"]; }
getValueByKey_4 = JsonObject.GetValueByKey(jsonObject=getValueByKey_3@L1, keys=code_block_13, Nesting=true, Option="None")
fromNameAndId_2 = BGNode.FromNameAndId(name=code_block_11, id=getValueByKey_4)
geometry = Element.Geometry(element=all_elements_of_category)
boundingBox = Geometry.BoundingBox(geometry=geometry)
code_block_14 = CodeBlock { ["CenterX","CenterY","CenterZ"]; }
getValueByKey_5 = JsonObject.GetValueByKey(jsonObject=getValueByKey_3@L1, keys=code_block_14, Nesting=true, Option="None")
code_block_15 = CodeBlock { 0; }
getItemAtIndex = List.GetItemAtIndex(list=getValueByKey_5@L2, index=code_block_15)
code_block_16 = CodeBlock { 1; }
getItemAtIndex_2 = List.GetItemAtIndex(list=getValueByKey_5@L2, index=code_block_16)
code_block_17 = CodeBlock { 2; }
getItemAtIndex_3 = List.GetItemAtIndex(list=getValueByKey_5@L2, index=code_block_17)
code_block_18 = CodeBlock { 1; }
add = getItemAtIndex_3 + code_block_18
byCoordinates = Point.ByCoordinates(x=getItemAtIndex, y=getItemAtIndex_2, z=add)
code_block_19 = CodeBlock { 0.2; }
translate = Geometry.Translate(geometry=byCoordinates, xTranslation=code_block_19, yTranslation=code_block_19, zTranslation=code_block_19)
byCorners = BoundingBox.ByCorners(min=translate, max=byCoordinates)
intersects = BoundingBox.Intersects(boundingBox=boundingBox, other=byCorners, lacing=CrossProduct)
flatten = List.Flatten(list=intersects@L3)

code_block_20 = CodeBlock { "ModelElements"; }
getValueByKey_6 = JsonObject.GetValueByKey(jsonObject=getValueByKey, keys=code_block_20, Nesting=true, Option="None")
addModelElements_2 = Custom[AddModelElements_2](Client=watch_2, ModelNode=createNode, AbstractElementNodes=fromNameAndId_2, x_AbstactElementData=getValueByKey_3, xyCrossResult=flatten, y_RevitElements=all_elements_of_category, modelElements=getValueByKey_6)

# group: Set space parameters
code_block_21 = CodeBlock { "Name"; }
code_block_22 = CodeBlock { "Name"; }
getValueByKey_7 = JsonObject.GetValueByKey(jsonObject=addModelElements_2.AbsractElementData, keys=code_block_22, Nesting=true, Option="None")
setParameterByName = Element.SetParameterByName(element=addModelElements_2.ModelElements, parameterName=code_block_21, value=getValueByKey_7)
code_block_23 = CodeBlock { "Number"; }
code_block_24 = CodeBlock { "Number"; }
getValueByKey_8 = JsonObject.GetValueByKey(jsonObject=addModelElements_2.AbsractElementData, keys=code_block_24, Nesting=true, Option="None")
setParameterByName_2 = Element.SetParameterByName(element=addModelElements_2.ModelElements, parameterName=code_block_23, value=getValueByKey_8)

# group: INPUT: Revit Levels
code_block_25 = CodeBlock { "Levels"; }
byName_2 = Category.ByName(name=code_block_25)

# group: Get all level data
code_block_26 = CodeBlock { "Level"; }
getValueByKey_9 = JsonObject.GetValueByKey(jsonObject=string_2, keys=code_block_26, Nesting=true, Option="None")
all_elements_of_category_2 = ElementsOfCategory(Category=byName_2)
elevation = Level.Elevation(level=all_elements_of_category_2)
code_block_27 = CodeBlock { "Elevation"; }
getValueByKey_10 = JsonObject.GetValueByKey(jsonObject=getValueByKey_9, keys=code_block_27, Nesting=true, Option="None")
eq = elevation == getValueByKey_10  # lacing=CrossProduct

# group: Get Level IDs
watch_6 = Watch(watch)
code_block_28 = CodeBlock { "Level"; }
code_block_29 = CodeBlock { ["Id"]; }
getValueByKey_11 = JsonObject.GetValueByKey(jsonObject=getValueByKey_9@L1, keys=code_block_29, Nesting=true, Option="None")
fromNameAndId_3 = BGNode.FromNameAndId(name=code_block_28, id=getValueByKey_11)

addModelElements_2_2 = Custom[AddModelElements_2](Client=watch_6, ModelNode=createNode, AbstractElementNodes=fromNameAndId_3, x_AbstactElementData=getValueByKey_9, xyCrossResult=eq, y_RevitElements=all_elements_of_category_2, modelElements=getValueByKey_6)

# group: Set Level Names
code_block_30 = CodeBlock { "Name"; }
code_block_31 = CodeBlock { "Name"; }
getValueByKey_12 = JsonObject.GetValueByKey(jsonObject=addModelElements_2_2.AbsractElementData, keys=code_block_31, Nesting=true, Option="None")
setParameterByName_3 = Element.SetParameterByName(element=addModelElements_2_2.ModelElements, parameterName=code_block_30, value=getValueByKey_12)

code_block_32 = CodeBlock { "ElectricalOutlets"; }
getValueByKey_13 = JsonObject.GetValueByKey(jsonObject=addModelElements_2.AbsractElementData, keys=code_block_32, Nesting=true, Option="None")
watch_7 = Watch(getValueByKey_13)
watch_8 = Watch(addModelElements_2.RevitElements)
geometry_2 = Element.Geometry(element=watch_8)

# group: Find sockets in each space
code_block_33 = CodeBlock { "Number_Of_Outlets"; }
getValueByKey_14 = JsonObject.GetValueByKey(jsonObject=watch_7, keys=code_block_33, Nesting=true, Option="None")
watch_9 = Watch(getValueByKey_14)
code_block_34 = CodeBlock { 2; }
eq_2 = watch_9 == code_block_34
family_types = FamilyTypes("HL_SocketOutlet_WallRecessed:2 Gang Switched")
family_types_2 = FamilyTypes("HL_SocketOutlet_WallRecessed:1 Gang Unswitched")
if_ = If(test=eq_2, true=family_types, false=family_types_2)
watch_10 = Watch(if_)
centroid = Solid.Centroid(solid=geometry_2)
watch_11 = Watch(centroid)

watch_12 = Watch(getValueByKey_6)

# group: Associate Levels to level model ellements
code_block_35 = CodeBlock { Client: var[]..[]; }  # unwired: Client
watch_13 = Watch(code_block_35)
code_block_36 = CodeBlock { AbstractElementNodes: var[]..[]; }  # unwired: AbstractElementNodes
code_block_37 = CodeBlock { xyCrossResult: var[]..[]; }  # unwired: xyCrossResult
filterByBoolMask = List.FilterByBoolMask(list=code_block_36, mask=code_block_37@L2)
code_block_38 = CodeBlock { x_AbstactElementData: var[]..[]; }  # unwired: x_AbstactElementData
filterByBoolMask_2 = List.FilterByBoolMask(list=code_block_38, mask=code_block_37@L2)
isEmpty = List.IsEmpty(list=filterByBoolMask_2.in@L2)
filterByBoolMask_3 = List.FilterByBoolMask(list=filterByBoolMask.in, mask=isEmpty)
code_block_39 = CodeBlock { "ModelElement"; }
code_block_40 = CodeBlock { modelElements: var[]..[]; }  # unwired: modelElements
code_block_41 = CodeBlock { "Id"; }
code_block_42 = CodeBlock { y_RevitElements: var[]..[]; }  # unwired: y_RevitElements
filterByBoolMask_4 = List.FilterByBoolMask(list=code_block_42, mask=isEmpty)
uniqueId = Element.UniqueId(element=filterByBoolMask_4.out)
filterByKeyAndValue = JsonData.Elements.JsonObject.FilterByKeyAndValue(jsonObjects=code_block_40, key=code_block_41, value=uniqueId@L1)
isEmpty_2 = List.IsEmpty(list=filterByKeyAndValue.in@L2)
code_block_43 = CodeBlock { ""; }
firstItem_2 = List.FirstItem(list=filterByKeyAndValue.in@L2)
code_block_44 = CodeBlock { "Id"; }
getValueByKey_15 = JsonObject.GetValueByKey(jsonObject=firstItem_2, keys=code_block_44, Nesting=true, Option="None")
if_2 = If(test=isEmpty_2, true=code_block_43, false=getValueByKey_15)
watch_14 = Watch(if_2)
fromNameAndId_4 = BGNode.FromNameAndId(name=code_block_39, id=watch_14)
code_block_45 = CodeBlock { ["UniqueId","ExternalID"]; }
id = Element.Id(element=filterByBoolMask_4.out)
list_create = List.Create(item0=uniqueId, item1=id)
transpose = List.Transpose(lists=list_create)
byKeysValues_3 = DesignScript.Builtin.Dictionary.ByKeysValues(keys=code_block_45, values=transpose@L2)
createNode_2 = Mutations.CreateNode(client=watch_13, node=fromNameAndId_4@L1, vars=byKeysValues_3@L1)
code_block_46 = CodeBlock { "REALIZED_BY"; }
relateNode = Mutations.RelateNode(client=watch_13, fromNode=filterByBoolMask_3.out, toNode=createNode_2, relationshipType=code_block_46)
code_block_47 = CodeBlock { ModelNode: var[]..[]; }  # unwired: ModelNode
code_block_48 = CodeBlock { "IS_IN"; }
relateNode_2 = Mutations.RelateNode(client=watch_13, fromNode=createNode_2, toNode=code_block_47, relationshipType=code_block_48)
code_block_49 = CodeBlock(ModelElements=filterByBoolMask_4.out) { ModelElements; }
filterByBoolMask_5 = List.FilterByBoolMask(list=filterByBoolMask_2.in, mask=isEmpty)
firstItem_3 = List.FirstItem(list=filterByBoolMask_5.out@L2)
code_block_50 = CodeBlock(AbsractElementData=firstItem_3) { AbsractElementData; }
code_block_51 = CodeBlock(ModelElementNode=createNode_2) { ModelElementNode; }
code_block_52 = CodeBlock(RevitElements=filterByBoolMask_4.out) { RevitElements; }
watch_15 = Watch(code_block_40)
